# Grasshopper definition 00_sunlighthours.gh (Grasshopper 0.9.76)
# plug-ins: Python Interpreter

constructlocation = Ladybug_ConstructLocation(locationName="unknown_Location", latitude="36", longitude=0, timeZone=0, elevation=0)  # -> location; plug-in component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
series = Series(Start="1", Step=1, Count="12")
series_2 = Series(Start=0, Step=1, Count="24")
sunpath = Ladybug_SunPath(
    location=constructlocation,
    hour=series_2,
    day=21,
    month=series,
    timeStep=1,
    sunPathScale=Slider(0.2, range=0..1),
    dailyOrAnnualSunPath=True)  # -> readMe, sunVectors, sunAltitudes, sunAzimuths, port, sunSpheresMesh, sunPathCrvs, legend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; plug-in component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
ladybug = Ladybug_Ladybug()  # -> Vviiiiiiiiiizzz; plug-in component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
brep = Brep(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)
radopaquematerial = HoneybeePlus_RadianceOpaqueMaterial(name="wall", reflect=".55", spec=0, rough=0)  # -> material; plug-in component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
panel = Panel("""1
2
3
4
5""")
radglassmaterial = HoneybeePlus_RadianceGlassMaterial(name="g_material", TVis=".6")  # -> material; plug-in component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
brep_2 = Brep(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)
wires = BrepWireframe(Brep=brep, Density=-1)
gentestpts = Honeybee_GenerateTestPoints(testGeometry=brep, gridSize=".5", distBaseSrf=Slider(0.762, range=0..1), moveTestMesh=True)  # -> readMe, simplify(testPoints), simplify(ptsVectors), simplify(facesArea), simplify(mesh); plug-in component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
panel_2 = Panel(radopaquematerial)
panel_3 = Panel(radglassmaterial)
preview = CustomPreview(Geometry=brep_2, Shader=ColourSwatch(SwatchColor=RGBA(211, 208, 255, 64)))
wires_2 = BrepWireframe(Brep=brep_2, Density=-1)
brep_3 = Brep([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])
wires_3 = BrepWireframe(Brep=brep_3, Density=-1)
brep_4 = Brep(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)
hbsurface = HoneybeePlus_HoneybeeSurface(geo=brep_2, name="glass_wall", radMat=radglassmaterial)  # -> readMe, HBSrf; plug-in component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
debrep = DeconstructBrep(Brep=brep_4)  # -> Faces, Edges, Vertices
analysisgrid = HoneybeePlus_AnalysisGrid(testPoints=gentestpts.testPoints, ptsVectors=gentestpts.ptsVectors)  # -> analysisGrid; plug-in component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
hbsurface_2 = HoneybeePlus_HoneybeeSurface(geo=brep_3, name=panel, radMat=radopaquematerial)  # -> readMe, HBSrf; plug-in component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
hbsurface_3 = HoneybeePlus_HoneybeeSurface(geo=debrep.Faces)  # -> readMe, HBSrf; plug-in component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

# ---- group: change the path to honeybeex folder
panel_4 = Panel("""C:\Users\Administrator\Documents\GitHub\honeybee
C:\Users\Administrator\Documents\GitHub\honeybee-plus""")
python = PythonScript(path_to_honeybee_libs=panel_4)  # -> readMe; inputs path_to_honeybee_libs: list
# ---------- python: Python ----------
import sys

if path_to_honeybee_libs:
    for p in path_to_honeybee_libs:
        sys.path.append(p)

import honeybee_grasshopper
import honeybee
import honeybee.hbsurface
# ---------- end python ----------

# ---- group: visualizeGeometry
python_2 = PythonScript(HBObjs=hbsurface.HBSrf)  # -> geo; inputs HBObjs: list
# ---------- python_2: Python ----------
geo = (hbo.geometry for hbo in HBObjs if hasattr(hbo, 'geometry'))
# ---------- end python_2 ----------

# ---- group: analysis recipe
sunlighthoursrecipe = HoneybeePlus_SunlightHoursRecipe(sunVectors=sunpath.sunVectors, analysisGrids=analysisgrid)  # -> analysisRecipe; plug-in component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

# ----
panel_5 = Panel(hbsurface_2.HBSrf)
panel_6 = Panel("test room")
data = Data(flatten([hbsurface_2.HBSrf, hbsurface.HBSrf, hbsurface_3.HBSrf]))
number_slider = Slider(2, range=0..10)
panel_7 = Panel(sunlighthoursrecipe)
toggle = BooleanToggle(False)
runradiance = HoneybeePlus_RunRadianceAnalysis(analysisRecipe=sunlighthoursrecipe, HBObjects=data, folder="c:\ladybug", name="untitled", write=toggle, run=toggle)  # -> readMe, results; plug-in component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
recolormesh = Ladybug_RecolorMesh(analysisResult=runradiance.results, inputMesh=gentestpts.mesh)  # -> readMe, newMesh, newLegend, legendBasePt, meshColors, legendColors; plug-in component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
