# Grasshopper definition 03_daylight_coefficient_daylight_analysis.gh (Grasshopper 0.9.76)
# plug-ins: Python Interpreter

radopaquematerial = HoneybeePlus_RadianceOpaqueMaterial(name="wall", reflect=".55", spec=0, rough=0)  # -> material; plug-in component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
radglassmaterial = HoneybeePlus_RadianceGlassMaterial(name="window_material", TVis=".6")  # -> material; plug-in component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
brep = Brep(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)
brep_2 = Brep(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)
panel = Panel("""9
10
11
12
13
14
15""")
path = FilePath("C:\EnergyPlusV8-6-0\WeatherData\USA_IL_Chicago-OHare.Intl.AP.725300_TMY3.epw")
wires = BrepWireframe(Brep=brep, Density=-1)
gentestpts = Honeybee_GenerateTestPoints(testGeometry=brep, gridSize="1", distBaseSrf=Slider(0.762, range=0..1), moveTestMesh=True)  # -> readMe, simplify(testPoints), simplify(ptsVectors), simplify(facesArea), simplify(mesh); plug-in component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
wea = HoneybeePlus_Wea(epwFile=path)  # -> wea; plug-in component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
panel_2 = Panel(radglassmaterial)
doy_hoy = Ladybug_DOY_HOY(days=1, months="6", hours=panel)  # -> HOY, DOY, date; plug-in component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
preview = CustomPreview(Geometry=brep_2, Shader=ColourSwatch(SwatchColor=RGBA(211, 208, 255, 64)))
wires_2 = BrepWireframe(Brep=brep_2, Density=-1)
brep_3 = Brep([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])
panel_3 = Panel(radopaquematerial)
brep_4 = Brep(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)
wires_3 = BrepWireframe(Brep=brep_3, Density=-1)
hbwinsrf = HoneybeePlus_HoneybeeWindowSurface(geo=brep_2, name="glass_wall", radMat=radglassmaterial)  # -> report, HBWinSrf; plug-in component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
debrep = DeconstructBrep(Brep=brep_4)  # -> Faces, Edges, Vertices
panel_4 = Panel(doy_hoy.HOY)
panel_5 = Panel("2")
analysisgrid = HoneybeePlus_AnalysisGrid(name="room", testPoints=gentestpts.testPoints, ptsVectors=gentestpts.ptsVectors)  # -> analysisGrid; plug-in component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
hbsurface = HoneybeePlus_HoneybeeSurface(geo=debrep.Faces)  # -> report, HBSrf; plug-in component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
hbsurface_2 = HoneybeePlus_HoneybeeSurface(geo=brep_3, radMat=radopaquematerial)  # -> report, HBSrf; plug-in component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

# ---- group: visualizeGeometry
python = PythonScript(HBObjs=hbwinsrf.HBWinSrf)  # -> geo; inputs HBObjs: list
# ---------- python: Python ----------
geo = next(hbo.geometry for hbo in HBObjs if hasattr(hbo, 'geometry'))
# ---------- end python ----------

# ----
skymatrix = HoneybeePlus_SkyMatrix(north=0, wea=wea, skyDensity=1)  # -> skyMTX; plug-in component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
skyvector = HoneybeePlus_SkyVector(north=0, wea=wea, month=6, day=21, hour="10")  # -> skyVec; plug-in component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
panel_6 = Panel(hbsurface_2.HBSrf)
panel_7 = Panel(analysisgrid)
panel_8 = Panel(skymatrix)
dcoeffgbrecipe = HoneybeePlus_DCGridBasedDaylightRecipe(skyMTX=skymatrix, analysisGrids=analysisgrid, analysisType=0, reuseDaylightMTX=Toggle(False))  # -> analysisRecipe; plug-in component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
data = Data(flatten([hbsurface_2.HBSrf, hbsurface.HBSrf]))
toggle = BooleanToggle(False)
panel_9 = Panel(dcoeffgbrecipe)
runradiance = HoneybeePlus_RunRadianceAnalysis(analysisRecipe=dcoeffgbrecipe, HBObjects=data, folder="c:\ladybug", name="discussion", write=toggle, run=toggle)  # -> readMe, legendPar, results; plug-in component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
number_slider = Slider(10000, range=0..10000)
panel_10 = Panel(runradiance.results)
panel_11 = Panel("100")

# ---- group: get daylight autonomy
python_2 = PythonScript(workingHours="9 To 17", threshold=300, minUsefulIllum=100, maxUsefulIllum=2000)  # -> DA, CDA, UDI, less, more; inputs results: list, threshold: Int32, minUsefulIllum: Int32, maxUsefulIllum: Int32
# ---------- python_2: Python ----------
if _results and _results[0]:
    stTime, endTime = _workingHours_
    _DA = [0] * len(_results[0])
    _CDA = [0] * len(_results[0])
    _UDI =  [0] * len(_results[0])
    _less =  [0] * len(_results[0])
    _more =  [0] * len(_results[0])

    nOfHours = 0
    for HOY, result in enumerate(_results):
        if not stTime <= HOY % 24 < endTime:
            continue
        nOfHours += 1
        for ptCount, ill in enumerate(result):
            _ill = float(ill)
            if _ill >= _threshold_:
                _DA[ptCount] += 1
                _CDA[ptCount] += 1
            else:
                _CDA[ptCount] += _ill /_threshold_
            
            if _ill < _minUsefulIllum_:
                _less[ptCount] += 1
            elif _ill > _maxUsefulIllum_:
                _more[ptCount] += 1
            else:
                _UDI[ptCount] += 1
    
    if nOfHours > 0:
        # divide values by the number of hours
        DA = (v / nOfHours * 100 for v in _DA)
        CDA = (v / nOfHours * 100 for v in _CDA)
        UDI = (v / nOfHours * 100 for v in _UDI)
        less = (v / nOfHours * 100 for v in _less)
        more = (v / nOfHours * 100 for v in _more)
# ---------- end python_2 ----------

# ---- group: hourly values
python_3 = PythonScript(grid=runradiance.results, hoy=Slider(14, range=0..100))  # -> illuminance; inputs hoy: Int32
# ---------- python_3: Python ----------
if _grid and _hoy:
    try:
        states = eval(blinds_state_)
    except:
        states = None
    illuminance = (p.combinedValueById(_hoy, states)[0] for p in _grid)
# ---------- end python_3 ----------

# ---- group: temporary solution until ladybug[+] is ready!
python_4 = PythonScript(x=runradiance.legendPar)  # -> a, b, c, d
# ---------- python_4: Python ----------
from System.Drawing import Color
if x:
    a = x.domain[0]
    b = x.domain[-1]
    c = 11
    d = (Color.FromArgb(1, c.r, c.g, c.b) for c in x.colors)
# ---------- end python_4 ----------

# ----
legendpar = Ladybug_LegendParameters(lowBound=python_4.a, highBound=python_4.b, numSegments=python_4.c, customColors=flatten(python_4.d))  # -> legendPar; plug-in component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
ladybug = Ladybug_Ladybug()  # -> Vviiiiiiiiiizzz; plug-in component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
recolormesh = Ladybug_RecolorMesh(analysisResult=python_3, inputMesh=gentestpts.mesh, legendPar=legendpar)  # -> readMe, newMesh, newLegend, legendBasePt, meshColors, legendColors; plug-in component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
