# Grasshopper definition 03_three_phase_daylight_analysis.gh (Grasshopper 0.9.76)
# plug-ins: Python Interpreter

radglassmaterial = HoneybeePlus_RadianceGlassMaterial(name="g_material", TVis=".6")  # -> material; plug-in component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
panel = Panel("C:\Users\Administrator\Documents\GitHub\honeybee\tests\room\xmls\clear.xml")
panel_2 = Panel(radglassmaterial)
radopaquematerial = HoneybeePlus_RadianceOpaqueMaterial(name="wall", reflect=".55", spec=0, rough=0)  # -> material; plug-in component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
panel_3 = Panel("""1
2
3
4
5""")
brep = Brep(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)

panel_4 = Panel("C:\Users\Administrator\Documents\GitHub\honeybee\tests\room\xmls\clear.xml")
panel_5 = Panel("C:\Users\Administrator\Documents\GitHub\honeybee\tests\room\xmls\clear.xml")
panel_6 = Panel("C:\Users\Administrator\Documents\GitHub\honeybee\tests\room\xmls\clear.xml")
hb3phasewindow = HoneybeePlus_HoneybeeSurface(geo=brep, name="group::1::north_glass", tMTXs=[panel_6, panel_4, panel_5])  # -> readMe, HBSrf; plug-in component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

brep_2 = Brep(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)
radbsdfmaterial = HoneybeePlus_RadianceBSDFMaterial(xmlfile=panel, upOrientation=Vector(0.01, 0.01, 1), thickness=0)  # -> material; plug-in component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
panel_7 = Panel(radopaquematerial)
wires = BrepWireframe(Brep=brep_2, Density=-1)
gentestpts = Honeybee_GenerateTestPoints(testGeometry=brep_2, gridSize="2", distBaseSrf=Slider(0.762, range=0..1), moveTestMesh=True)  # -> readMe, simplify(testPoints), simplify(ptsVectors), simplify(facesArea), simplify(mesh); plug-in component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
preview = CustomPreview(Geometry=brep, Shader=ColourSwatch(SwatchColor=RGBA(211, 208, 255, 64)))
wires_2 = BrepWireframe(Brep=brep, Density=-1)
brep_3 = Brep([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])

# ---- group: change the path to honeybeex folder
panel_8 = Panel("""C:\Users\Administrator\Documents\GitHub\honeybee
C:\Users\Administrator\Documents\GitHub\honeybee-plus""")
python = PythonScript(path_to_honeybee_libs=panel_8)  # -> readMe; inputs path_to_honeybee_libs: list
# ---------- python: Python ----------
import sys

if path_to_honeybee_libs:
    for p in path_to_honeybee_libs:
        sys.path.append(p)

import honeybee
import honeybee_grasshopper
import honeybee.hbsurface
# ---------- end python ----------

# ----
wires_3 = BrepWireframe(Brep=brep_3, Density=-1)

# ---- group: specific multi-phase xml file
radbsdfmaterial_2 = HoneybeePlus_RadianceBSDFMaterial(xmlfile=panel_6, upOrientation=Vector(0.01, 0.01, 1))  # -> material; plug-in component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

# ----
brep_4 = Brep(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)
hbsurface = HoneybeePlus_HoneybeeSurface(geo=brep, name="group::1::north_glass", radMat=radbsdfmaterial)  # -> readMe, HBSrf; plug-in component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
points = PointList(Points=gentestpts.testPoints)
path = FilePath("C:\EnergyPlusV8-3-0\WeatherData\USA_CA_San.Francisco.Intl.AP.724940_TMY3.epw")
debrep = DeconstructBrep(Brep=brep_4)  # -> Faces, Edges, Vertices
analysisgrid = HoneybeePlus_AnalysisGrid(testPoints=gentestpts.testPoints)  # -> analysisGrid; plug-in component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
skymatrix = HoneybeePlus_SkyMatrix(epwFile=path, skyDensity=1)  # -> skyMTX; plug-in component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
hbsurface_2 = HoneybeePlus_HoneybeeSurface(geo=brep_3, name=panel_3, radMat=radopaquematerial)  # -> readMe, HBSrf; plug-in component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
panel_9 = Panel(hbsurface_2.HBSrf)
hbsurface_3 = HoneybeePlus_HoneybeeSurface(geo=debrep.Faces)  # -> readMe, HBSrf; plug-in component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

# ---- group: visualizeGeometry
python_2 = PythonScript(HBObjs=hbsurface.HBSrf)  # -> geo; inputs HBObjs: list
# ---------- python_2: Python ----------
geo = (hbo.geometry for hbo in HBObjs if hasattr(hbo, 'geometry'))
# ---------- end python_2 ----------

# ----
python_3 = PythonScript(x=hbsurface_3.HBSrf)  # -> out, a
# ---------- python_3: Python ----------
print x.toRadString()

print x.toRadString(reverse=True)
# ---------- end python_3 ----------
threephaserecipe = HoneybeePlus_ThreePhaseDaylightRecipe(skyMTX=skymatrix, analysisGrid=analysisgrid, reuseViewMTX=True, reuseDaylightMTX=True)  # -> analysisRecipe; plug-in component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
data = Data(flatten([hbsurface.HBSrf, hbsurface_2.HBSrf, hbsurface_3.HBSrf]))
panel_10 = Panel("test room")
panel_11 = Panel("C:\Users\Administrator\Documents\GitHub\honeybee-plus\plugin\grasshopper")
python_4 = PythonScript(x=threephaserecipe)  # -> out, a
# ---------- python_4: Python ----------
print x.subFolder
# ---------- end python_4 ----------
toggle = BooleanToggle(False)
number_slider = Slider(7, range=7..20)
panel_12 = Panel(threephaserecipe)
panel_13 = Panel(python_4.out)
exportladybug = Ladybug_ExportLadybug(targetFolder=panel_11, export=Toggle(False))  # -> readMe; plug-in component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
runradiance = HoneybeePlus_RunRadianceAnalysis(HBObjects=data, folder="c:\ladybug", name="test_0", write=toggle, run=toggle)  # -> readMe, results; plug-in component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
number_slider_2 = Slider(10000, range=0..10000)
doy_hoy = Ladybug_DOY_HOY(days="21", months="8", hours=number_slider)  # -> HOY, DOY, date; plug-in component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
panel_14 = Panel("100")
importlocation = Ladybug_ImportLocation(epwFile=path)  # -> location; plug-in component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
panel_15 = Panel(doy_hoy.HOY)
panel_16 = Panel(runradiance.readMe)

# ---- group: get daylight autonomy
python_5 = PythonScript(results=runradiance.results, workingHours="9 To 17", threshold=300, minUsefulIllum=100, maxUsefulIllum=2000)  # -> DA, CDA, UDI, less, more; inputs results: list, threshold: Int32, minUsefulIllum: Int32, maxUsefulIllum: Int32
# ---------- python_5: Python ----------
if _results and _results[0]:
    stTime, endTime = _workingHours_
    _DA = [0] * len(_results[0])
    _CDA = [0] * len(_results[0])
    _UDI =  [0] * len(_results[0])
    _less =  [0] * len(_results[0])
    _more =  [0] * len(_results[0])
    nOfHours = 0
    for HOY, result in enumerate(_results):
        if not stTime <= HOY % 24 < endTime:
            continue
        nOfHours += 1
        for ptCount, ill in enumerate(result):
            _ill = float(ill)
            if _ill >= _threshold_:
                _DA[ptCount] += 1
                _CDA[ptCount] += 1
            else:
                _CDA[ptCount] += _ill /_threshold_
            
            if _ill < _minUsefulIllum_:
                _less[ptCount] += 1
            elif _ill > _maxUsefulIllum_:
                _more[ptCount] += 1
            else:
                _UDI[ptCount] += 1
    
    # divide values by the number of hours
    DA = (v / nOfHours * 100 for v in _DA)
    CDA = (v / nOfHours * 100 for v in _CDA)
    UDI = (v / nOfHours * 100 for v in _UDI)
    less = (v / nOfHours * 100 for v in _less)
    more = (v / nOfHours * 100 for v in _more)
# ---------- end python_5 ----------

# ----
sunpath = Ladybug_SunPath(
    location=importlocation,
    hour=number_slider,
    day="21",
    month="8",
    timeStep=1,
    sunPathScale=".25",
    dailyOrAnnualSunPath=True)  # -> readMe, sunVectors, sunAltitudes, sunAzimuths, port, sunSpheresMesh, sunPathCrvs, legend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; plug-in component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

# ---- group: get annual results for an hour of year
python_6 = PythonScript(results=runradiance.results, hoy=panel_15)  # -> illuminance; inputs results: list, hoy: Int32
# ---------- python_6: Python ----------
if _results and _results[0] and _hoy:
    illuminance = (float(i) for i in _results[_hoy])
# ---------- end python_6 ----------

# ----
recolormesh = Ladybug_RecolorMesh(analysisResult=python_6, inputMesh=gentestpts.mesh)  # -> readMe, newMesh, newLegend, legendBasePt, meshColors, legendColors; plug-in component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
ladybug = Ladybug_Ladybug()  # -> Vviiiiiiiiiizzz; plug-in component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
legendpar = Ladybug_LegendParameters(highBound="100")  # -> legendPar; plug-in component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
