# Grasshopper definition 04_daylight_coefficient_daylight_analysis_Image.gh (Grasshopper 0.9.76)
# plug-ins: Python Interpreter, Embryo

brep = Brep(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)
brep_2 = Brep([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])
panel = Panel("""north_glass_1
north_glass_2""")
preview = CustomPreview(Geometry=brep, Shader=ColourSwatch(SwatchColor=RGBA(211, 208, 255, 64)))
preview_2 = CustomPreview(Geometry=brep_2, Shader=ColourSwatch(SwatchColor=RGBA(211, 208, 255, 64)))
panel_2 = Panel("""12
16
19""")
hbwinsrf = HoneybeePlus_HoneybeeWindowSurface(geo=brep_2, name=panel)  # -> readMe, HBWindowSrf; plug-in component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

# ---- group: This window will be it's own group
hbwinsrf_2 = HoneybeePlus_HoneybeeWindowSurface(geo=brep, name="skylight")  # -> readMe, HBWindowSrf; plug-in component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

# ----
wires = BrepWireframe(Brep=brep_2, Density=-1)
path = FilePath("C:\EnergyPlusV8-3-0\WeatherData\USA_CA_San.Francisco.Intl.AP.724940_TMY3.epw")
series = Series(Start="9", Step=1, Count="6")
brep_3 = Brep([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])
pt = Point(Point(1, 1, 2))
pt_2 = Point(Point(2.761757981, 3.184085208, 2.438065029))
wea = HoneybeePlus_Wea(epwFile=path)  # -> wea; plug-in component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
ln = Line(StartPoint=pt, EndPoint=pt_2)
panel_3 = Panel("""1
2
3
4
5
6""")
wires_2 = BrepWireframe(Brep=brep_3, Density=-1)
vec = Vector(ln)
skymatrix = HoneybeePlus_SkyMatrix(north=0, wea=wea, skyDensity=1, hoys=panel_2)  # -> skyMTX; plug-in component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
preview_3 = CustomPreview(Geometry=wires_2, Shader=ColourSwatch(SwatchColor=RGB(0, 0, 0)))
view = HoneybeePlus_View(
    name="inside_NE",
    vLocation=pt,
    vDirection=vec,
    vUpVector=Point(0, 0, 1),
    viewType=0,
    hViewAngle="60",
    vViewAngle=45,
    xResolution="500",
    yResolution="500")  # -> view; plug-in component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
hbsurface = HoneybeePlus_HoneybeeSurface(geo=brep_3, name=panel_3)  # -> readMe, HBSrf; plug-in component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
skyvector = HoneybeePlus_SkyVector(north=0, wea=wea, month=6, day=21, hour="15")  # -> skyVec; plug-in component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
dcoeffgbrecipe = HoneybeePlus_DCImageBasedDaylightRecipe(skyMTX=skyvector, views=view, analysisType=2, reuseDaylightMTX=True)  # -> analysisRecipe; plug-in component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
data = Data(flatten([hbsurface.HBSrf, hbwinsrf_2.HBWindowSrf, hbwinsrf.HBWindowSrf]))
panel_4 = Panel("C:\Users\Administrator\Documents\GitHub\honeybee-plus\plugin\grasshopper")
python = PythonScript()  # -> out, a
# ---------- python: Python ----------
from ladybug.dt import LBDateTime

h = LBDateTime.fromHOY(20)
print h.date()
# ---------- end python ----------
runradiance = HoneybeePlus_RunRadianceAnalysis(analysisRecipe=dcoeffgbrecipe, HBObjects=data, folder="c:\ladybug", name="workshop", write=Toggle(True))  # -> readMe, results; plug-in component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
ladybug = Ladybug_Ladybug()  # -> Vviiiiiiiiiizzz; plug-in component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
honeybee = Honeybee_Honeybee()  # -> Vviiiiiiiiiizzz; plug-in component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
exportladybug = Ladybug_ExportLadybug(targetFolder=panel_4, export=Toggle(True))  # -> readMe; plug-in component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
panel_5 = Panel(runradiance.readMe)
falsecolor = Honeybee_FalseColor(contourBands=False, maskThreshold=0.1, useAlterColors=False, render=Toggle(False))  # -> outputFilePath; plug-in component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
hdr_tif = Honeybee_ConvertHDRToTIF(HDRFilePath=runradiance.results, adjustExposure=Toggle(True))  # -> TIFFFilePath; plug-in component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
item = ListItem(List=hdr_tif, Index=Slider(0, range=0..6), Wrap=True)
image = ImageFromPath(P=item, S=Slider(0.8, range=0..1))

# ---- group: change the path to honeybeex folder
panel_6 = Panel("""ladybug
honeybee
honeybee-plus""")
panel_7 = Panel("C:\Users\Administrator\Documents\GitHub\")

# ----
concat = Concatenate(FragmentA=panel_7, FragmentB=panel_6)

# ---- group: change the path to honeybeex folder (continued)
python_2 = PythonScript(path_to_honeybee_libs=concat)  # -> readMe; inputs path_to_honeybee_libs: list
# ---------- python_2: Python ----------
import sys

if path_to_honeybee_libs:
    for p in path_to_honeybee_libs:
        sys.path.append(p)

import honeybee_grasshopper
import honeybee
import honeybee.hbsurface
# ---------- end python_2 ----------
