# Grasshopper definition honeybee_daylight.gh (Grasshopper 0.9.76)
# plug-ins: Python Interpreter, Human UI, Human

panel = Panel("""JAN
FEB
MAR
APR
MAY
JUN
JUL
AUG
SEP
OCT
NOV
DEC""")
panel_2 = Panel("""Month
Day
Hour""")
panel_3 = Panel("""[0] illuminance (lux)
[1] radiation (kwh)
[2] luminance (Candela)""")
panel_4 = Panel("""CIE Sky
Climate-based Sky""")
panel_5 = Panel("""Daylight Factor
Grid based Analysis""")
series = Series(Start="1", Step=1, Count="31")
docunits = ConvertToDocumentUnits(ValueString="0.5m")
docunits_2 = ConvertToDocumentUnits(ValueString="0.75m")
int = Integer(series)
textbox = CreateTextBox(Label="Distance from surface", DefaultText=docunits_2, UpdateButton=True)
textbox_2 = CreateTextBox(Label="Grid Size", DefaultText=docunits, UpdateButton=True)
label = CreateLabel(LabelText=panel_2, LabelSize=12, Justification=0)
pulldown = CreatePulldownMenu(ListItems=int, SelectedIndex="20")
pulldown_2 = CreatePulldownMenu(ListItems=panel, SelectedIndex="2")
slider = CreateSlider(Slider=Slider(9, range=0..24), ShowBounds=False, ShowTicks=False, ShowTooltip=False, ShowValLabel=True)
item = ListItem(List=label, Index=0, Wrap=True)  # -> Item, Item1, Item2
pulldown_3 = CreatePulldownMenu(ListItems=panel_3)
pulldown_4 = CreatePulldownMenu(ListItems=panel_4)
pulldown_5 = CreatePulldownMenu(ListItems=panel_5)
panel_6 = Panel("""1. Create Sky
2. Simulation Type
3. Create test points""")
merge = Merge(
    Data1=flatten(item.Item),
    Data2=flatten(pulldown_2),
    Data3=item.Item1,
    Data4=flatten(pulldown),
    Data5=item.Item2,
    Data6=flatten(slider))
tb = CreateTextBlock(Text="0 points are created.", TextSize=12, Justification=0)
toggle = CreateToggle(Default=False, OnLabel="Hide points", OffLabel="Show points")
checkbox = CreateCheckbox(Label="Select the test surface in Rhino and then check this box.", StartingValue=Toggle(False))
stack = CreateStack(UIElements=flatten([textbox_2, textbox]), Horizontal=True)
stack_2 = CreateStack(UIElements=flatten(merge), Horizontal=True)
filepicker = CreateFilePicker(ButtonLabelText="Pick epw weather file", DialogType=0, MustExist=True, Filter="*.epw")
label_2 = CreateLabel(LabelText=panel_6, LabelSize=18, Justification=0)
item_2 = ListItem(List=label_2, Index=0, Wrap=True)  # -> Item, Item1, Item2
merge_2 = Merge(
    Data1=flatten(pulldown_5),
    Data2=flatten(item_2.Item),
    Data3=flatten(pulldown_4),
    Data4=flatten(filepicker),
    Data5=flatten(stack_2),
    Data6=flatten(item_2.Item1),
    Data7=flatten(pulldown_3),
    Data8=flatten(item_2.Item2),
    Data9=flatten(stack),
    Data10=flatten(checkbox),
    Data11=flatten(tb),
    Data12=flatten(toggle))

ladybug = Ladybug_Ladybug()  # -> Vviiiiiiiiiizzz; plug-in component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
honeybee = Honeybee_Honeybee()  # -> Vviiiiiiiiiizzz; plug-in component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

# ---- group: 0::Scene
callfromlibrary = Honeybee_CallFromRadianceLibrary()  # -> materials; plug-in component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
layertable = LayerTable(Update=Toggle(True), AutoUpdate=False)  # -> Layers, FullLayerPaths, LayerColors, Linetypes, MaterialNames, Visible, PrintWidth, PrintColor
data = Data(callfromlibrary)
lng = ListLength(List=data)
range = Range(Domain=Domain(0, 1), Steps=expr("x - 1", lng))
checkbox_2 = CreateCheckbox(Label=layertable.Layers, StartingValue=Toggle(True))
lng_2 = ListLength(List=checkbox_2)
gradient = Gradient(
    LowerLimit=0,
    UpperLimit=1,
    Parameter=range,
    stops=[0: RGB(243, 57, 0), 0.1: RGB(236, 27, 60), 0.2: RGB(210, 0, 118), 0.3: RGB(103, 0, 120), 0.4: RGB(39, 72, 161), 0.5: RGB(1, 192, 229), 0.6: RGB(18, 178, 90), 0.7: RGB(79, 186, 8), 0.8: RGB(220, 237, 32), 0.9: RGB(247, 159, 20), 1: RGB(243, 57, 0)])
rectangle = Rectangle(Plane=PlaneXY(0, 0, 0), XSize="-10 To -20", YSize="-10 To -20", Radius=0)  # -> Rectangle, Length
dup = DuplicateData(Data=data, Number=lng_2, Order=True)
dup_2 = DuplicateData(Data=rectangle.Rectangle, Number=lng_2, Order=True)  # -> graft(Data)
partition = PartitionList(List=dup, Size=lng)  # -> simplify(Chunks)
item_3 = ListItem(List=gradient, Index="0", Wrap=True)  # -> graft(Item)
shape = CreateShape(Shape=dup_2, FillColor=item_3, StrokeColor=RGB(0, 0, 0), Scale=1)  # -> flatten(Shape)
pulldown_6 = CreatePulldownMenu(ListItems=partition, SelectedIndex="0")  # -> flatten(Pulldown)
pipeline = GeometryPipeline(
    GroupByLayer=False,
    GroupByType=False,
    IncludeHidden=True,
    IncludeLocked=True,
    LayerFilter="*",
    NameFilter="*",
    TypeFilter=1073741880)
panel_7 = Panel("Check this box to create honeybee surfaces from the selected layers.")
weave = Weave(Pattern=[0, 1, 2], Stream0=shape, Stream1=flatten(checkbox_2), Stream2=flatten(pulldown_6), NullGaps=False)
objatts = ObjectAttributes(ObjectOrAttributes=pipeline)  # -> Name, LayerName, LayerFullPath, Color, MaterialName, LinetypeName, GroupIndices, PlotWeight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
partition_2 = PartitionList(List=weave, Size="3")
_3dview = Create3DView(MeshToDisplay=pipeline, MeshColors=objatts.Color, ViewWidth="425", ViewHeight=300)
label_3 = CreateLabel(LabelText="1. Pick layers and materials", LabelSize=18, Justification=0)
stack_3 = CreateStack(UIElements=partition_2, Horizontal=True)  # -> flatten(Stack)
checkbox_3 = CreateCheckbox(Label=panel_7, StartingValue=Toggle(False))
label_4 = CreateLabel(LabelText="2. Create Honeybee Surfaces.", LabelSize=18, Justification=0)
label_5 = CreateLabel(LabelText="Radiance scene. Objects are colored based on materials.", LabelSize=12, Justification=1)
textbox_3 = CreateTextBox(UpdateButton=False)
tb_2 = CreateTextBlock(Text="...", TextSize=12, Justification=0)
adjustpos = AdjustElementPositioning(ElementsToAdjust=stack_3, Margin="30, 0, 0, 0", AbsolutePositioning=False, HorizontalAlignment=0)
merge_3 = Merge(
    Data1=label_3,
    Data2=flatten(stack_3),
    Data3=flatten(_3dview),
    Data4=label_5,
    Data5=label_4,
    Data6=checkbox_3,
    Data7=tb_2)

# ----
panel_8 = Panel("""            0 - Original Ladybug
            1 - Nuanced Ladybug
            2 - Multi-colored Ladybug
            3 - View Analysis 1
            4 - View Analysis 2 (Red,Green,Blue)
            5 - Sunlight Hours
            6 - Ecotect
            7 - Thermal Comfort Percentage
            8 - Thermal Comfort Colors
            9 - Thermal Comfort Colors (UTCI)
            10 - Hot Hours
            11 - Cold Hours
            12 - Shade Benefit/Harm
            13 - Thermal Comfort Colors v2 (UTCI)
            14 - Shade Harm
            15 - Shade Benefit
            16 - Black to White
            17 - CFD Colors 1
            18 - CFD Colors 2
            19 - Energy Balance
            20 - THERM
            21 - Cloud Cover
            22 - Glare Potential
            23 - Radiation Benefit""")
textbox_4 = CreateTextBox(Label="Higher bound", DefaultText="500", UpdateButton=True)
textbox_5 = CreateTextBox(Label="Lower bound", DefaultText="0", UpdateButton=True)
pulldown_7 = CreatePulldownMenu(ListItems=panel_8)
stack_4 = CreateStack(UIElements=flatten([textbox_5, textbox_4]), Horizontal=True)

# ---- group: Run
checkbox_4 = CreateCheckbox(Label="Run?", StartingValue=Toggle(False))
tb_3 = CreateTextBlock(Text="...", TextSize=12, Justification=0)
label_6 = CreateLabel(LabelText="Report", LabelSize=18, Justification=0)
merge_4 = Merge(
    Data1=flatten(checkbox_4),
    Data2=flatten(stack_4),
    Data3=flatten(pulldown_7),
    Data4=flatten(label_6),
    Data5=flatten(tb_3))

# ----
pan = Panel("""0::Scene
1::Recipe
2::Run""")
tabs = TabbedView(TabNames=pan, TabTextSize="20", Tab0=flatten(merge_3), Tab1=flatten(merge_2), Tab2=flatten(merge_4))
launchwin = LaunchWindow(Show=Toggle(False), Name="Honeybee[rh]-Daylighting", Width="425", Height="650", ChildStatus=1, EnableHorizScroll=False)
addelems = AddElements(Window=launchwin, Elements=flatten(tabs), DoVLChecking=True)  # -> AddedElements, ElementNames

# ---- group: Scene
values = ValueListener(Elements=checkbox_2, SomeProperty=True)  # -> flatten(Values), Indices
values_2 = ValueListener(Elements=pulldown_6, SomeProperty=True)  # -> flatten(Values), Indices
values_3 = ValueListener(Elements=checkbox_3, SomeProperty=True)  # -> flatten(Values), Indices
panel_9 = Panel("""Brep
Mesh
Extrusion""")
int_2 = Integer(values_3.Values)
mdispatch = DispatchMultiple(DispatchPattern=values.Values, List0=layertable.Layers, List1=values_2.Values)  # -> List0, List1
dpipeline = DynamicGeometryPipeline(
    LayerFilter=mdispatch.List0,
    TypeFilter=panel_9,
    NameFilter="*",
    enableFullPath=False,
    GroupByLayer=False,
    GroupByType=False,
    IncludeHidden=True,
    IncludeLocked=True,
    listenToAttriubtes=True)
hideshow = HideShowElement(ElementToHideShow=pulldown_6, Show=values.Values, Collapse=False, Disable=False)
lng_3 = ListLength(List=dpipeline)
larger = LargerThan(FirstNumber=lng_3, SecondNumber=0)  # -> flatten(LargerThan), OrEqualTo
clean = CleanTree(RemoveNulls=True, RemoveInvalid=True, RemoveEmpty=True, Tree=dpipeline)
mdispatch_2 = DispatchMultiple(DispatchPattern=larger.LargerThan, List0=mdispatch.List1)  # -> List0, List1
graft = GraftTree(Tree=mdispatch_2.List0, IncludeEmptyLists=True, IncludeNullItems=True)  # -> simplify(Tree)
fsim = FindSimilarMember(Data=flatten(graft), Set=flatten(data))  # -> Hit, Index
fsim_2 = FindSimilarMember(Data=flatten(values_2.Values), Set=flatten(data))  # -> Hit, Index
gate = StreamGate(Stream=clean, Gate=int_2)  # -> Target0, Target1
item_4 = ListItem(List=gradient, Index=fsim.Index, Wrap=True)
item_5 = ListItem(List=gradient, Index=fsim_2.Index, Wrap=True)
lng_4 = ListLength(List=clean)
graft_2 = GraftTree(Tree=item_4, IncludeEmptyLists=True, IncludeNullItems=True)  # -> simplify(Tree)
dup_3 = DuplicateData(Data=graft_2, Number=lng_4, Order=True)
setshape = SetShape(ShapeToModify=shape, FillColor=item_5, StrokeColor=RGB(0, 0, 0), Scale=1)
createhbsrfs = Honeybee_createHBSrfs(geometry=gate.Target1, RADMaterial=graft)  # -> readMe, simplify(flatten(HBSurface)); plug-in component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
set3dview = Set3DView(_3DView=_3dview, MeshToDisplay=flatten(clean), MeshColors=flatten(dup_3))
flatten = FlattenTree(Tree=createhbsrfs.readMe, Path="{0}")
panel_10 = Panel("")
join = TextJoin(Text=flatten, Join=panel_10)
filter = StreamFilter(Gate=int_2, Stream0="...", Stream1=join)
settextblock = SetTextBlockContents(TextBlockToModify=tb_2, NewTextBlockContents=filter)

# ----
values_4 = ValueListener(Elements=checkbox_4, SomeProperty=True)  # -> Values, Indices
bool = Boolean(values_4.Values)
values_5 = ValueListener(Elements=pulldown_7, SomeProperty=True)  # -> Values, Indices
values_6 = ValueListener(Elements=textbox_5, SomeProperty=True)  # -> Values, Indices
values_7 = ValueListener(Elements=textbox_4, SomeProperty=True)  # -> Values, Indices
gradientlibrary = Ladybug_GradientLibrary(gradIndex=values_5.Indices)  # -> customColors; plug-in component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
legendpar = Ladybug_LegendParameters(lowBound=values_6.Values, highBound=values_7.Values, customColors=flatten(gradientlibrary))  # -> legendPar; plug-in component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

# ---- group: recipe
values_8 = ValueListener(Elements=filepicker, SomeProperty=True)  # -> Values, Indices
values_9 = ValueListener(Elements=pulldown_2, SomeProperty=True)  # -> Values, Indices
values_10 = ValueListener(Elements=pulldown, SomeProperty=True)  # -> Values, Indices
values_11 = ValueListener(Elements=slider, SomeProperty=True)  # -> Values, Indices
genclimatebasedsky = Honeybee_GenerateClimateBasedSky(weatherFile=values_8.Values, month=values_9.Indices, day=values_10.Values, hour=values_11.Values)  # -> radiationValues, skyFilePath; plug-in component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
values_12 = ValueListener(Elements=checkbox, SomeProperty=True)  # -> Values, Indices
selobj = ObjectsBySelection(Reset=values_12.Values, LiveMode=False)
values_13 = ValueListener(Elements=textbox, SomeProperty=True)  # -> Values, Indices
values_14 = ValueListener(Elements=textbox_2, SomeProperty=True)  # -> Values, Indices
gentestpts = Honeybee_GenerateTestPoints(testGeometry=selobj, gridSize=values_14.Values, distBaseSrf=values_13.Values, moveTestMesh=True)  # -> readMe, simplify(testPoints), simplify(ptsVectors), simplify(facesArea), simplify(mesh); plug-in component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
values_15 = ValueListener(Elements=toggle, SomeProperty=True)  # -> Values, Indices
values_16 = ValueListener(Elements=pulldown_3, SomeProperty=True)  # -> Values, Indices
clean_2 = CleanTree(RemoveNulls=True, RemoveInvalid=True, RemoveEmpty=False, Tree=flatten(gentestpts.testPoints))
gridbasedsimulation = Honeybee_GridBasedSimulation(
    skyFile=genclimatebasedsky.skyFilePath,
    testPoints=gentestpts.testPoints,
    ptsVectors=gentestpts.ptsVectors,
    simulationType=values_16.Indices)  # -> analysisRecipe; plug-in component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
lng_5 = ListLength(List=flatten(clean_2))
filter_2 = StreamFilter(Gate=values_15.Values, Stream1=clean_2)
preview = CustomPreview(Geometry=filter_2, Shader=ColourSwatch(SwatchColor=RGB(44, 201, 255)))

# ----
lng_6 = ListLength(List=flatten(selobj))

# ---- group: recipe (continued)
concat = Concatenate(FragmentA=lng_6, FragmentB=" surfaces are selected.", FragmentC=lng_5, FragmentD=" points are created.")
settextblock_2 = SetTextBlockContents(TextBlockToModify=tb, NewTextBlockContents=concat)

# ----
rundaylightanalysis = Honeybee_RunDaylightSimulation(
    HBObjects=flatten(createhbsrfs.HBSurface),
    analysisRecipe=gridbasedsimulation,
    writeRad=bool,
    runRad=bool,
    overwriteResults=True)  # -> readMe, analysisType, resultsUnit, illuminance_values, testPts, illuminance_files, radGeoFile, studyFolder, done; plug-in component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
panel_11 = Panel(rundaylightanalysis.readMe)
join_2 = TextJoin(Text=panel_11, Join=panel_10)
filter_3 = StreamFilter(Gate=bool, Stream0="Set run to True!", Stream1=join_2)
settextblock_3 = SetTextBlockContents(TextBlockToModify=tb_3, NewTextBlockContents=filter_3)
recolormesh = Ladybug_RecolorMesh(
    analysisResult=rundaylightanalysis.illuminance_values,
    inputMesh=gentestpts.mesh,
    legendPar=legendpar,
    analysisTitle=rundaylightanalysis.analysisType,
    legendTitle=rundaylightanalysis.resultsUnit)  # -> readMe, newMesh, newLegend, legendBasePt, meshColors, legendColors; plug-in component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
