# Dynamo graph 03_solaraccess_gridbased.dyn (Dynamo 1.3.0.875)

boolean = BoolSelector(true)
collect_rooms_and_spaces = Custom[Collect Rooms and Spaces](collect=boolean)  # Collect rooms and MEP spaces in the Revit document. Use "Rooms to HBZones" node to convert them to Honeybee zones.

# group: This component fails for complex geometries. In those cases you can create the model surface by surface. You can also vote at the link below here so Autodesk opens up the Room API, so we can get the openings without failure! http://forums.autodesk.com/t5/revit-ideas/ api-access-to-room-openings-geometry-and-materials-in-revit/ idi-p/6642406
rooms_to_hbzones = Custom[Rooms to HBZones](rooms=collect_rooms_and_spaces.rooms)  # Create Honeybee zones from Revit Rooms or MEPSpaces. This node currently ONLY collects geometrical data from Revit. In the future it will import constructions, materials and MEP data (e.g lighting power density).

code_block = CodeBlock { 500; 750; }
generate_test_points_from = Custom[Generate Test Points from HBZones](HBZones=rooms_to_hbzones.HBZones, gridSize=code_block.out0, disFromSurface=code_block.out1)  # Generate test points from Honeybee zones based on grid size.
byPatch = Surface.ByPatch(generate_test_points_from.polygons)
analysis_grid = Custom[Analysis Grid](testPoints=generate_test_points_from.testPts, ptsVectors=generate_test_points_from.ptsNormal)  # Analysis Grid. -
daylight_factor_recipe = Custom[Daylight Factor Recipe](analysisGrids=analysis_grid.analysisGrid)  # Daylight factor Recipe. -
flatten = Flatten(rooms_to_hbzones.HBZones)
code_block_2 = CodeBlock { "c:/ladybug"; "dynamo_sample_files"; true; }
boolean_2 = BoolSelector(false)
run_radiance_analysis = Custom[Run Radiance Analysis](analysisRecipe=daylight_factor_recipe.analysisRecipe, HBObjects=flatten, folder=code_block_2.out0, name=code_block_2.out1, write=code_block_2.out2, run=boolean_2)  # Run Radiance Analysis -
hourly_values = Custom[Hourly Values](analysisGrid=run_radiance_analysis.outputs)  # Hourly results for an analysis grid for a single hour of the year. -
code_block_3 = CodeBlock { {0, 5}; }
legend_parameters = Custom[Legend Parameters](domain=code_block_3)  # Use this component to change the colors, numerical range, and/or number of divisions of any Ladybug legend along with the corresponding colored mesh that the legend refers to. Any Ladybug component that outputs a colored mesh and a legend will have an input that can accept Legend Parameters from this component. This component particularly helpful in making the colors of Ladybug graphics consistent for a presentation or for synchonizing the numerical range and colors between Ladybug graphics. -
generate_colors = Custom[Generate Colors](values=hourly_values.values, legendPar=legend_parameters.legendPar)  # Color a test surface based on the results of a study. The results structure should match the test points structure to be mapped correctly on the surface.
byGeometryColor = Display.Display.ByGeometryColor(byPatch, generate_colors.colors)
file_path = Filename("C:\EnergyPlusV8-3-0\WeatherData\USA_CA_San.Francisco.Intl.AP.724940_TMY3.epw")
import_location = Custom[Import Location](epwFile=file_path)  # Import location data from an epw weather file
code_block_4 = CodeBlock { 9; 21; 8..18; }
calculate_hoy = Custom[Calculate HOY](month=code_block_4.out0, day=code_block_4.out1, hour=code_block_4.out2)  # Calculate hour of year for a month, day and hour
code_block_5 = CodeBlock { 250; }
sunpath = Custom[Sunpath](location=import_location.location, hoursOfYear=calculate_hoy.hoy, scale=code_block_5)  # Use this node to make a 3D sun-path (aka. sun plot) in the Dynamo scene. The node also outputs sun vectors that can be used for sunlight hours analysis or shading design with the other Ladybug nodes.
byStartPointEndPoint = Line.ByStartPointEndPoint(startPoint=sunpath.centerPt, endPoint=sunpath.sunPositions)
solar_access_recipe = Custom[Solar Access Recipe](sunVectors=sunpath.sunVectors, analysisGrids=analysis_grid.analysisGrid)  # Solar Access Recipe. -; unwired: hoys
watch = Watch(analysis_grid.ERRReport)
