# Grasshopper definition analysisRecipe.gh (Grasshopper 0.9.76)
# plug-ins: Python Interpreter

panel = Panel("C:\Users\Administrator\Documents\GitHub\honeybee-grasshopper")
planesrf = PlaneSurface(Plane=PlaneXY(0, 0, 0), XSize="20", YSize="20")
python = PythonScript(path_to_honeybee_libs=panel)  # -> readMe
# ---------- python: Python ----------
from scriptcontext import sticky

sticky["hb_lib_path"] = path_to_honeybee_libs
# ---------- end python ----------
wires = BrepWireframe(Brep=planesrf, Density=-1)
number_slider = Slider(20, range=0..100)

# ---- group: Radiance parameters
radpar = PythonScript(quality=Slider(2, range=0..10))  # -> radParameters; inputs quality: Int32, ab: Int32, ad: Int32, as: Int32, ar: Int32
# ---------- radpar: Python ----------
import sys
from scriptcontext import sticky

if "hb_lib_path" in sticky:
    sys.path.append(sticky["hb_lib_path"])

try:
    from honeybeegrasshopper.radiance import parameters
    from honeybeegrasshopper import wrapper
except ImportError:
    raise ImportError("Failed to import Honeybee libraries.\n" + \
                      "Set-up path to Honeybee libraries in honeybee_honeybee component")

if _quality:
    radParameters = parameters.RadianceParameters(_quality)
    if _ab_: radParameters.ab = _ab_
    if _ad_: radParameters.ad = _ad_
    if _as_: radParameters.as_ = _as_
    if _ar_: radParameters.ar = _ar_
    if _aa_: radParameters.aa = _aa_
    
    #print radParameters
    #wrap the object
    radParameters = wrapper.Wrapper(radParameters)
# ---------- end radpar ----------

# ---- group: sky library
sky = PythonScript(illuminanceValue=Slider(200, range=0..1000))  # -> HBSky
# ---------- sky: Python ----------
import sys
from scriptcontext import sticky

if "hb_lib_path" in sticky:
    sys.path.append(sticky["hb_lib_path"])

try:
    from honeybeegrasshopper.radiance.sky.certainIlluminance import SkyWithCertainIlluminanceLevel
    from honeybeegrasshopper.wrapper import Wrapper
except ImportError:
    raise ImportError("Failed to import Honeybee libraries.\n" + \
                      "Set-up path to Honeybee libraries in honeybee_honeybee component")

if _illuminanceValue:
    HBSky = Wrapper(SkyWithCertainIlluminanceLevel(_illuminanceValue))
# ---------- end sky ----------

# ----
python_2 = PythonScript(name="wall", reflect=".55", spec=0, rough=0)  # -> material
# ---------- python_2: Python ----------
import sys
from scriptcontext import sticky

if "hb_lib_path" in sticky:
    sys.path.append(sticky["hb_lib_path"])

try:
    from honeybeegrasshopper.radiance.material.plastic import PlasticMaterial
    from honeybeegrasshopper.wrapper import Wrapper
except ImportError:
    raise ImportError("Failed to import Honeybee libraries.\n" + \
                      "Set-up path to Honeybee libraries in honeybee_honeybee component")



if _name and _reflect:
    material = PlasticMaterial.bySingleReflectValue(_name, _reflect, _spec_, _rough_)
    
    material = Wrapper(material)
# ---------- end python_2 ----------
sdivide = DivideSurface(Surface=planesrf, UCount=number_slider, VCount=number_slider)  # -> Points, Normals, Parameters
panel_2 = Panel(python_2)
panel_3 = Panel(sky)
panel_4 = Panel(radpar)

# ---- group: I'm not sure if we need this extra step
python_3 = PythonScript(material=python_2)  # -> radProp
# ---------- python_3: Python ----------
import sys
from scriptcontext import sticky

if "hb_lib_path" in sticky:
    sys.path.append(sticky["hb_lib_path"])

try:
    from honeybeegrasshopper.radiance.properties import RadianceProperties
    from honeybeegrasshopper.wrapper import Wrapper
except ImportError:
    raise ImportError("Failed to import Honeybee libraries.\n" + \
                      "Set-up path to Honeybee libraries in honeybee_honeybee component")


radProp = RadianceProperties(_material_.unwrap(), True) if _material_ else RadianceProperties()
radProp = Wrapper(radProp)
# ---------- end python_3 ----------

# ----
move = Move(Geometry=sdivide.Points, Motion="0,0,0.05")  # -> Geometry, Transform

# ---- group: analysis recipe
gridbased = PythonScript(HBSky=sky, testPoints=move.Geometry, ptsVectors=sdivide.Normals, radParameters=radpar)  # -> analysisRecipe; inputs testPoints: tree of Point3d, ptsVectors: tree of Vector3d
# ---------- gridbased: Python ----------
import sys
from scriptcontext import sticky

if "hb_lib_path" in sticky:
    sys.path.append(sticky["hb_lib_path"])

try:
    from honeybeegrasshopper.radiance.recipe.gridbased import GridBasedAnalysisRecipe
    from honeybeegrasshopper import wrapper
except ImportError:
    raise ImportError("Failed to import Honeybee libraries.\n" + \
                      "Set-up path to Honeybee libraries in honeybee_honeybee component")

if _HBSky and _testPoints and ptsVectors_:
    if _radParameters_:
        _radParameters_ = _radParameters_.unwrap()
    
    analysisRecipe = GridBasedAnalysisRecipe(
        _HBSky.unwrap(), _testPoints, ptsVectors_, _radParameters_
        )
    
    analysisRecipe = wrapper.Wrapper(analysisRecipe)
# ---------- end gridbased ----------

# ----
panel_5 = Panel(python_3)

# ---- group: HBHive is not implemented yet- the component outputs the surface itself
python_4 = PythonScript(geo=planesrf, radProp=python_3)  # -> readMe, HBSrf; inputs geo: GeometryBase, type: Int32
# ---------- python_4: Python ----------
import sys
from scriptcontext import sticky

if "hb_lib_path" in sticky:
    sys.path.append(sticky["hb_lib_path"])

try:
    from honeybeegrasshopper.hbsurface import HBSurface
    from honeybeegrasshopper.wrapper import Wrapper
except ImportError:
    raise ImportError("Failed to import Honeybee libraries.\n" + \
                      "Set-up path to Honeybee libraries in honeybee_honeybee component")

from uuid import uuid4

if _geo:
    
    isNameSetByUser = True
    if not name_:
        name_ = "Surface_%s" % uuid4()
        isNameSetByUser = False
        
    isTypeSetByUser = True
    if not _type_:
        isTypeSetByUser = False
    
    radProp_ = radProp_.unwrap() if radProp_ else None
    
    epProp_ = epProp_.unwrap() if epProp_ else None
    
    HBSrf = HBSurface(name_, _geo, _type_, isNameSetByUser,isTypeSetByUser,
                      radProp_, epProp_)

    HBSrf = Wrapper(HBSrf)
# ---------- end python_4 ----------

# ----
panel_6 = Panel(gridbased)
panel_7 = Panel(python_4.HBSrf)
python_5 = PythonScript(recipe=gridbased, HBObjs=python_4.HBSrf, folder="c:\ladybug", name="untitled", write=Toggle(True))  # -> readMe, results; inputs HBObjs: tree, write: Boolean, run: Boolean
# ---------- python_5: Python ----------
_HBObjs.Flatten()
_HBObjs = _HBObjs.Branch(0)

if _HBObjs and _recipe:
    _recipe = _recipe.unwrap()
    _HBObjs = [objs.unwrap() for objs in _HBObjs]

    if _write:
        _recipe.hbObjects = _HBObjs
        _recipe.writeToFile(_folder_, _name_)
    
    if _write and run_:
        results = _recipe.run(False)
# ---------- end python_5 ----------
panel_8 = Panel(python_5.readMe)
